# Grasshopper definition sunpath.gh (Grasshopper 0.9.76)
# plug-ins: Python Interpreter

ladybug = Ladybug_Ladybug()  # -> Vviiiiiiiiiizzz; plug-in component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
analysisperiod = Ladybug_AnalysisPeriod(fromMonth=Slider(12, range=0..12), toMonth=Slider(12, range=0..12))  # -> readMe, analysisPeriod; plug-in component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
analysisperiod_2 = Ladybug_AnalysisPeriod(fromMonth=Slider(5, range=0..12), toMonth=Slider(5, range=0..12))  # -> readMe, analysisPeriod; plug-in component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
analysisperiod_3 = Ladybug_AnalysisPeriod(fromMonth=Slider(8, range=0..12), toMonth=Slider(8, range=0..12))  # -> readMe, analysisPeriod; plug-in component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
constructlocation = Ladybug_ConstructLocation(locationName="Gift City", latitude="23.152356", longitude="72.683712", timeZone="+05.30", elevation="64")  # -> location; plug-in component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
panel = Panel("4")
panel_2 = Panel("12")
panel_3 = Panel("21")
number_slider = Slider(5, range=1..12)
number_slider_2 = Slider(12, range=0..23)
number_slider_3 = Slider(21, range=1..31)
ground = Geometry(<brep referenced from the Rhino model>)
area = Area(Geometry=ground)  # -> Area, Centroid
sunpath = Ladybug_SunPath(
    location=constructlocation,
    hour=12,
    day=21,
    month=12,
    timeStep=1,
    analysisPeriod=analysisperiod_3.analysisPeriod,
    centerPt=area.Centroid,
    sunPathScale="1.5",
    dailyOrAnnualSunPath=True)  # -> readMe, sunVectors, sunAltitudes, sunAzimuths, port, sunSpheresMesh, sunPathCrvs, compassCrvs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; plug-in component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
toggle = BooleanToggle(False)
brep = Brep([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])
geo = Geometry([sunpath.compassCrvs, sunpath.sunPathCrvs])
sunlighthoursanalysis = Ladybug_SunlightHoursAnalysis(
    geometry=flatten(brep),
    gridSize="1",
    disFromBase="0.5",
    sunVectors=flatten(sunpath.sunVectors),
    timeStep=1,
    parallel=toggle,
    runIt=toggle)  # -> readMe, contextMesh, analysisMesh, testPts, testVec, port, sunlightHoursResult, sunlightHoursMesh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; plug-in component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
mcol = MeshColours(Mesh=sunpath.sunSpheresMesh, Colours=ColourSwatch(SwatchColor=RGB(255, 187, 0)))
preview = CustomPreview(Geometry=geo, Shader=ColourSwatch(SwatchColor=RGB(105, 105, 105)))
data = Data(Tree({0}: [0, 0, 0, 0, 0, 0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], {1}: [86, 86, 86, 86, 86, 86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], {2}: [0, 0, 0, 0, 0, 0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], {3}: [141, 141, 141, 141, 141, 141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], {4}: [226, 226, 226, 226, 226, 226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], {5}: [186, 186, 186, 186, 186, 186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]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))
mesh = Mesh(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)
geo_2 = Geometry([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])
panel_4 = Panel(analysisperiod_3.analysisPeriod)
item = ListItem(List=panel_4, Index="0", Wrap=True)
item_2 = ListItem(List=panel_4, Index="1", Wrap=True)
panel_5 = Panel(item)
panel_6 = Panel(item_2)
split = TextSplit(Text=panel_5, Separators="(,) ")
panel_7 = Panel(split)
item_3 = ListItem(List=panel_7, Index="3", Wrap=True)
item_4 = ListItem(List=panel_7, Index="1", Wrap=True)
item_5 = ListItem(List=panel_7, Index="5", Wrap=True)
date = ConstructDate(Year="2017", Month=item_4, Day=item_3, Hour=item_5, Minute=0, Second=0)
panel_8 = Panel(date)
