# Grasshopper definition sunpath_R1.gh (Grasshopper 0.9.76)
# plug-ins: Python Interpreter

number_slider = Slider(7, range=7..17)
ladybug = Ladybug_Ladybug()  # -> Vviiiiiiiiiizzz; plug-in component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
number_slider_2 = Slider(7, range=6..18)
addition = Addition(A=number_slider, B="1")
fly = Ladybug_fly(inputSliders=number_slider, fly=Toggle(False))  # -> Vviiiiiiiiiizzz; plug-in component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
analysisperiod = Ladybug_AnalysisPeriod(
    fromMonth=Slider(12, range=0..12),
    fromDay=Slider(1, range=1..24),
    fromHour=number_slider,
    toMonth=Slider(12, range=0..12),
    toDay=Slider(1, range=1..24),
    toHour=addition)  # -> readMe, analysisPeriod; plug-in component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
constructlocation = Ladybug_ConstructLocation(locationName="Gift City", latitude="23.152356", longitude="72.683712", timeZone="+05.30", elevation="64")  # -> location; plug-in component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
number_slider_3 = Slider(5, range=1..12)
number_slider_4 = Slider(12, range=0..23)
number_slider_5 = Slider(21, range=1..31)
ground = Geometry(<brep referenced from the Rhino model>)
area = Area(Geometry=ground)  # -> Area, Centroid
panel = Panel(analysisperiod.analysisPeriod)
sunpath = Ladybug_SunPath(
    location=constructlocation,
    hour=12,
    day=21,
    month=12,
    timeStep=1,
    analysisPeriod=analysisperiod.analysisPeriod,
    centerPt=area.Centroid,
    sunPathScale="1.5",
    dailyOrAnnualSunPath=True)  # -> readMe, sunVectors, sunAltitudes, sunAzimuths, port, sunSpheresMesh, sunPathCrvs, compassCrvs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; plug-in component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
item = ListItem(List=panel, Index="0", Wrap=True)
item_2 = ListItem(List=panel, Index="1", Wrap=True)
panel_2 = Panel(item)
panel_3 = Panel(item_2)
toggle = BooleanToggle(True)
brep = Brep([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])
geo = Geometry([sunpath.compassCrvs, sunpath.sunPathCrvs])
split = TextSplit(Text=panel_2, Separators="(,) ")
sunlighthoursanalysis = Ladybug_SunlightHoursAnalysis(
    geometry=flatten(brep),
    gridSize="5",
    disFromBase="0.5",
    sunVectors=flatten(sunpath.sunVectors),
    timeStep=1,
    parallel=toggle,
    runIt=toggle)  # -> readMe, contextMesh, analysisMesh, testPts, testVec, port, sunlightHoursResult, sunlightHoursMesh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; plug-in component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
mcol = MeshColours(Mesh=sunpath.sunSpheresMesh, Colours=ColourSwatch(SwatchColor=RGB(255, 187, 0)))
preview = CustomPreview(Geometry=geo, Shader=ColourSwatch(SwatchColor=RGB(105, 105, 105)))
panel_4 = Panel(split)
item_3 = ListItem(List=panel_4, Index="3", Wrap=True)
item_4 = ListItem(List=panel_4, Index="1", Wrap=True)
item_5 = ListItem(List=panel_4, Index="5", Wrap=True)
mesh = Mesh(sunlighthoursanalysis.sunlightHoursMesh)
geo_2 = Geometry(sunlighthoursanalysis.sunlightHoursLegend)
data = Data(sunlighthoursanalysis.sunlightHoursResult)
date = ConstructDate(Year="2018", Month=item_4, Day=item_3, Hour=item_5, Minute=0, Second=0)
panel_5 = Panel(date)
captureview = Ladybug_CaptureView(
    fileName=number_slider,
    folder="C:\Users\Bijit\Dropbox\Github\Building-Science\Sunpath",
    viewNames="02",
    transparBack=Toggle(False),
    capture=Toggle(True))  # -> imagePath; plug-in component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
tag = TextTag(Location="-115,-150,0", Text=panel_5)
tag_2 = TextTag3D(Location="-115,-150,0", Text=panel_5, Size="10", Colour=ColourSwatch(SwatchColor=RGB(0, 0, 0)), Justification=7)
