# Grasshopper definition Indoor Airflow_R2.gh (Grasshopper 1.0.7)
# plug-ins: Ironbug

# ----
# Get Average Temperature
panel = Panel("C:\Users\Bijit\Dropbox\Github\Building-Science\EPW\IND_Ahmedabad.426470_ISHRAE.epw")
importepw = Ladybug_ImportEpw(epwFile=panel)  # -> readMe, latitude, location, dryBulbTemperature, dewPointTemperature, relativeHumidity, windSpeed, windDirection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; plug-in component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
analysisperiod = Ladybug_AnalysisPeriod(fromMonth=Slider(1, range=1..12), toMonth=Slider(12, range=1..12))  # -> readMe, analysisPeriod; plug-in component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
selectandaveragedata = Ladybug_AverageData(
    annualHourlyData=importepw.dryBulbTemperature,
    analysisPeriod=analysisperiod.analysisPeriod,
    totalOrAverage=Toggle(False))  # -> readMe, selHourlyData, averagedDaily, averagedMonthly, avrMonthlyPerHour, avrMonthlyMinPerHour, avrMonthlyMaxPerHour; plug-in component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
split = SplitList(List=selectandaveragedata.avrMonthlyMaxPerHour, Index="7")  # -> ListA, ListB
panel_2 = Panel(split.ListB)
num = Number(panel_2)
avr = Average(Input=num)

# ----
# Get Average Relative Humidity
panel_3 = Panel("C:\Users\Bijit\Dropbox\Github\Building-Science\EPW\IND_Ahmedabad.426470_ISHRAE.epw")
importepw_2 = Ladybug_ImportEpw(epwFile=panel_3)  # -> readMe, latitude, location, dryBulbTemperature, dewPointTemperature, relativeHumidity, windSpeed, windDirection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; plug-in component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
analysisperiod_2 = Ladybug_AnalysisPeriod(fromMonth=Slider(1, range=1..12), toMonth=Slider(12, range=1..12))  # -> readMe, analysisPeriod; plug-in component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
selectandaveragedata_2 = Ladybug_AverageData(
    annualHourlyData=importepw_2.relativeHumidity,
    analysisPeriod=analysisperiod_2.analysisPeriod,
    totalOrAverage=Toggle(False))  # -> readMe, selHourlyData, averagedDaily, averagedMonthly, avrMonthlyPerHour, avrMonthlyMinPerHour, avrMonthlyMaxPerHour; plug-in component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
split_2 = SplitList(List=selectandaveragedata_2.averagedMonthly, Index="7")  # -> ListA, ListB
panel_4 = Panel(split_2.ListB)
num_2 = Number(panel_4)
avr_2 = Average(Input=num_2)

# ----
# Get Average Wind Direction
panel_5 = Panel("C:\Users\Bijit\Dropbox\Github\Building-Science\EPW\IND_Ahmedabad.426470_ISHRAE.epw")
importepw_3 = Ladybug_ImportEpw(epwFile=panel_5)  # -> readMe, latitude, location, dryBulbTemperature, dewPointTemperature, relativeHumidity, windSpeed, windDirection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; plug-in component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
analysisperiod_3 = Ladybug_AnalysisPeriod(fromMonth=Slider(1, range=1..12), toMonth=Slider(2, range=1..12))  # -> readMe, analysisPeriod; plug-in component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
selectandaveragedata_3 = Ladybug_AverageData(annualHourlyData=importepw_3.windDirection, analysisPeriod=analysisperiod_3.analysisPeriod, totalOrAverage=Toggle(False))  # -> readMe, selHourlyData, averagedDaily, averagedMonthly, avrMonthlyPerHour, avrMonthlyMinPerHour, avrMonthlyMaxPerHour; plug-in component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
split_3 = SplitList(List=selectandaveragedata_3.avrMonthlyMinPerHour, Index="7")  # -> ListA, ListB
panel_6 = Panel(split_3.ListB)
num_3 = Number(panel_6)
avr_3 = Average(Input=num_3)

# ----
# This file is set up in meters. If you're using a different units make sure to scale the input geometries.
# Get average wind speed
panel_7 = Panel("C:\Users\Bijit\Dropbox\Github\Building-Science\EPW\IND_Ahmedabad.426470_ISHRAE.epw")
importepw_4 = Ladybug_ImportEpw(epwFile=panel_7)  # -> readMe, latitude, location, dryBulbTemperature, dewPointTemperature, relativeHumidity, windSpeed, windDirection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; plug-in component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
analysisperiod_4 = Ladybug_AnalysisPeriod(fromMonth=Slider(1, range=1..12), toMonth=Slider(12, range=1..12))  # -> readMe, analysisPeriod; plug-in component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
selectandaveragedata_4 = Ladybug_AverageData(annualHourlyData=importepw_4.windSpeed, analysisPeriod=analysisperiod_4.analysisPeriod, totalOrAverage=Toggle(False))  # -> readMe, selHourlyData, averagedDaily, averagedMonthly, avrMonthlyPerHour, avrMonthlyMinPerHour, avrMonthlyMaxPerHour; plug-in component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
split_4 = SplitList(List=selectandaveragedata_4.averagedMonthly, Index="7")  # -> ListA, ListB
panel_8 = Panel(split_4.ListB)
num_4 = Number(panel_8)
avr_4 = Average(Input=num_4)

# ----
# Get Average Pressure
panel_9 = Panel("C:\Users\Bijit\Dropbox\Github\Building-Science\EPW\IND_Ahmedabad.426470_ISHRAE.epw")
importepw_5 = Ladybug_ImportEpw(epwFile=panel_9)  # -> readMe, latitude, location, dryBulbTemperature, dewPointTemperature, relativeHumidity, windSpeed, windDirection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; plug-in component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
analysisperiod_5 = Ladybug_AnalysisPeriod(fromMonth=Slider(1, range=1..12), toMonth=Slider(12, range=1..12))  # -> readMe, analysisPeriod; plug-in component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
selectandaveragedata_5 = Ladybug_AverageData(
    annualHourlyData=importepw_5.barometricPressure,
    analysisPeriod=analysisperiod_5.analysisPeriod,
    totalOrAverage=Toggle(False))  # -> readMe, selHourlyData, averagedDaily, averagedMonthly, avrMonthlyPerHour, avrMonthlyMinPerHour, avrMonthlyMaxPerHour; plug-in component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
split_5 = SplitList(List=selectandaveragedata_5.averagedMonthly, Index="7")  # -> ListA, ListB
panel_10 = Panel(split_5.ListB)
num_5 = Number(panel_10)
avr_5 = Average(Input=num_5)

panel_11 = Panel("C:\Users\Bijit\Dropbox\Github\Building-Science\EPW\IND_Ahmedabad.426470_ISHRAE.epw")
importepw_6 = Ladybug_ImportEpw(epwFile=panel_11)  # -> readMe, latitude, location, dryBulbTemperature, dewPointTemperature, relativeHumidity, windSpeed, windDirection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; plug-in component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
analysisperiod_6 = Ladybug_AnalysisPeriod(fromMonth=Slider(6, range=1..12), toMonth=Slider(7, range=1..12))  # -> readMe, analysisPeriod; plug-in component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
windrose = Ladybug_WindRose(
    north=0,
    hourlyWindDirection=importepw_6.windDirection,
    hourlyWindSpeed=importepw_6.windSpeed,
    analysisPeriod=analysisperiod_6.analysisPeriod,
    scale="0.2",
    runIt=Toggle(False))  # -> readMe, calmRoseMesh, windRoseMesh, windRoseCrvs, windRoseCenPts, legend, legendBasePts, title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; plug-in component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
panel_12 = Panel(avr)
panel_13 = Panel("C:\Users\Bijit\Desktop\butterfly0005 (1)\IAF\NBC Velovity Norm.JPG")
panel_14 = Panel(avr_3)
panel_15 = Panel(avr_2)
panel_16 = Panel(avr_5)
panel_17 = Panel(avr_4)
vec = VectorXYZ(XComponent=avr_4, YComponent=avr_4, ZComponent=0)  # -> Vector, Length
panel_18 = Panel(windrose.windDirections)
selectandaveragedata_6 = Ladybug_AverageData(
    annualHourlyData=windrose.averageVelocities,
    analysisPeriod=analysisperiod_6.analysisPeriod,
    totalOrAverage=Toggle(False))  # -> readMe, selHourlyData, averagedDaily, averagedMonthly, avrMonthlyPerHour, avrMonthlyMinPerHour, avrMonthlyMaxPerHour; plug-in component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
viewer = Ladybug_ImageViewer(ImagePath_=panel_13, _scale_=1, DisableClickable=False, SaveImgWithCoords=False, scale=1)  # -> ImagePath, Colors, GIF
wall = Butterfly_WallBoundary(temperature="40")  # -> wall_boundary; plug-in component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
outlet = Butterfly_OutletBoundary(temperature="40")  # -> outlet_boundary; plug-in component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
panel_19 = Panel("""x=cos(a)
y=sin(a)""")
python = GhPythonScript(x=Slider(77, range=0..360))  # -> a, b
# ---------- python: Python ----------
"""Provides a scripting component.
    Inputs:
        x: The x script variable
        y: The y script variable
    Output:
        a: The a output variable
        b: The a output variable"""

__author__ = "Bijit"
__version__ = "2020.07.23"

import rhinoscriptsyntax as rs
import math

degree = int(x)
radian = (degree*math.pi)/180

a = math.cos(radian)
b = math.sin(radian)
# ---------- end python ----------
vec_2 = VectorXYZ(XComponent=python.a, YComponent=python.b, ZComponent=0)  # -> Vector, Length

# ---- group: inlet!
srf = Surface([<surface referenced from the Rhino model> x4])

# ---- group: walls
brep = Brep([<brep referenced from the Rhino model> x14])

# ---- group: outlet
srf_2 = Surface([<surface referenced from the Rhino model> x6])

# ----
split_6 = SplitList(List=selectandaveragedata_6.avrMonthlyMinPerHour, Index="7")  # -> ListA, ListB
panel_20 = Panel(split_6.ListB)
windvector = Butterfly_WindVector(wind_speed=avr_4, wind_direction=vec_2.Vector)  # -> wind_vector; plug-in component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
inletvel = Butterfly_InletBoundary(velocity_vec=windvector, temperature="40")  # -> inlet_boundary; plug-in component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
# 0. CREATE BUTTERFLY SURFACES
area = Area(Geometry=srf)  # -> Area, Centroid
num_6 = Number(panel_20)
wires = BrepWireframe(Brep=brep, Density=-1)

jagged = SettingsSpeed()
createbfgeometry = Butterfly_CreateButterflyGeometry(name="SW_window", geo=flatten(srf), boundary=inletvel, refine_levels="(2, 2)", mesh_set=jagged)  # -> report, BF_geo; plug-in component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
createbfgeometry_2 = Butterfly_CreateButterflyGeometry(name="room", geo=flatten(brep), boundary=wall, mesh_set=jagged)  # -> report, BF_geo; plug-in component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
createbfgeometry_3 = Butterfly_CreateButterflyGeometry(name="NE_window", geo=flatten(srf_2), boundary=outlet, refine_levels="(2, 2)", mesh_set=jagged)  # -> report, BF_geo; plug-in component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

preview = CustomPreview(Geometry=srf_2, Shader=ColourSwatch(SwatchColor=RGBA(255, 0, 255, 77)))
preview_2 = CustomPreview(Geometry=srf, Shader=ColourSwatch(SwatchColor=RGBA(136, 191, 255, 77)))
vdis = VectorDisplay(Anchor=area.Centroid, Vector=windvector)
avr_6 = Average(Input=num_6)
panel_21 = Panel(avr_6)
vdisex = VectorDisplayEx(Point="0,0,0", Vector=windvector, Colour=ColourSwatch(SwatchColor=RGB(255, 0, 0)), Width=2)
python_2 = GhPythonScript(x=avr_6)  # -> a, b; same code as python
vec_3 = VectorXYZ(XComponent=python_2.a, YComponent=python_2.b, ZComponent=0)  # -> Vector, Length
windvector_2 = Butterfly_WindVector(wind_speed="10", wind_direction=vec_3.Vector)  # -> wind_vector; plug-in component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

# ----
# 1. CREATE OPENFOAM CASE
panel_22 = Panel("indoor_airflow")
casefromgeos = Butterfly_CreateCaseFromGeometries(
    name=panel_22,
    BF_geo=flatten([createbfgeometry_2.BF_geo, createbfgeometry_3.BF_geo, createbfgeometry.BF_geo]),
    expand_block_mesh=True,
    run=Toggle(False))  # -> report, block_pts, case; plug-in component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

# ---- group: turn off the sanp to get the hard edges correctly
toggle = BooleanToggle(False)

# ----
rotate = Rotate(Geometry=windvector_2, Angle=Slider(181, range=1..360), Plane=PlaneXY(0, 0, 0))  # -> Geometry, Transform

larger_than_90_to_get_the_hard_edges = Panel("castellatedMeshControls  {resolveFeatureAngle 95;}")
snappyhexmeshdict = Butterfly_snappyHexMeshDict(
    castellated_mesh=True,
    snap=toggle,
    add_layers=False,
    n_cells_btwn_levels=3,
    max_global_cells=2000000,
    srf_feature_level="3",
    expansion_ratio=1.1,
    final_layer_thickness=0.7,
    min_thickness=0.1,
    n_layer_iter=50,
    additional_par=larger_than_90_to_get_the_hard_edges)  # -> snappy_hex_mesh_dict; plug-in component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

vdisex_2 = VectorDisplayEx(Point="0,0,0", Vector=rotate.Geometry, Colour=ColourSwatch(SwatchColor=RGB(255, 0, 0)), Width=2)
python_3 = GhPythonScript(x=Slider(69, range=0..360))  # -> a, b; same code as python
toggle_2 = BooleanToggle(False)
panel_23 = Panel(python_3.a)
panel_24 = Panel(python_3.b)
# PURGE CASE
purgecase = Butterfly_purgeCase(case=casefromgeos.case, block_mesh=toggle_2, snappy_hex_mesh=toggle_2, results=toggle_2, post_processing=toggle_2)  # -> report; plug-in component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
panel_25 = Panel(casefromgeos.report)
# 2.1. BLOCKMESH
blockmesh = Butterfly_blockMesh(case=casefromgeos.case, overwrite=True, write=Toggle(True), run=Toggle(True))  # -> report, case; plug-in component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

# ---- group: update inlet wind velocity
panel_26 = Panel("""boundaryField
{


west_window
    {

  
value		uniform (2.5 0.0 0.0);


}
}""")
panel_27 = Panel("U")

# ----
section_02 = Brep(<brep referenced from the Rhino model>)
f00 = Brep(<brep referenced from the Rhino model>)

gentestpts = Honeybee_GenerateTestPoints(testGeometry=f00, gridSize=Slider(0.3, range=0..1), distBaseSrf="0.05", moveTestMesh=Toggle(False))  # -> readMe, simplify(testPoints), simplify(ptsVectors), simplify(facesArea), simplify(mesh); plug-in component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
flatten = FlattenTree(Tree=gentestpts.mesh, Path="{0}")
flatten_2 = FlattenTree(Tree=gentestpts.testPoints, Path="{0}")

f01 = Brep(<brep referenced from the Rhino model>)
section_01 = Brep(<brep referenced from the Rhino model>)
section_02_2 = Brep(<brep referenced from the Rhino model>)
# 2. MESHING
# 2.2. SNAPPYHEXMESH
snappyhexmesh = Butterfly_snappyHexMesh(case=blockmesh.case, snappy_hex_mesh_dict=snappyhexmeshdict, write=Toggle(False), run=Toggle(False))  # -> report, case; plug-in component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

epsilonwallfunction = Butterfly_epsilonWallFunction(Cmu=0.09, kappa=0.4, E=9.8)  # -> epsilon_wall_funct; plug-in component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
nutkwallfunction = Butterfly_nutkWallFunction()  # -> nutk_wall_funct; plug-in component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
calculated = Butterfly_calculated()  # -> calculated; plug-in component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
zerogradient = Butterfly_zeroGradient()  # -> zero_gradient; plug-in component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
kqrwallfunction = Butterfly_kqRWallFunction(value="0.01")  # -> kqR_wall_funct; plug-in component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
fixedvalue = Butterfly_fixedValue(value="(0 0 0)")  # -> fixed_value; plug-in component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

# ----
# Create your own boundary
# from boundary conditions
panel_28 = Panel("patch")
solutionparam = Butterfly_SolutionParameter(filename=panel_27, values=panel_26, replace=False)  # -> solution_par; plug-in component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
panel_29 = Panel("""p
U""")
panel_30 = Panel(nutkwallfunction)
panel_31 = Panel(snappyhexmesh.report)
controldict = Butterfly_controlDict(start_time=0, end_time="5000", write_interval=100, write_compression=False, purge_write=0)  # -> control_dict; plug-in component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
boundary = Butterfly_Boundary(b_type=panel_28, U=zerogradient, p=zerogradient, k=zerogradient, epsilon=calculated, nut=calculated)  # -> report, boundary; plug-in component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
decomposepardict_scotch = Butterfly_decomposeParDictScotch(num_of_cpus="2")  # -> decompose_par_dict; plug-in component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
probes = Butterfly_probes(points=flatten_2, fields=panel_29)  # -> probes; plug-in component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
loadmesh = Butterfly_LoadMesh(case=snappyhexmesh.case, inner_mesh=False, load=Toggle(False))  # -> mesh; plug-in component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
steadyincomp = Butterfly_SteadyIncompressibleRecipe()  # -> report, recipe; plug-in component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
solutionparams = Butterfly_SolutionParameters(control_dict=controldict, probes=probes)  # -> solution_par; plug-in component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
# Solution should be converged in 606 iterations with default settings.
# 3. SOLUTION
solution = Butterfly_Solution(
    case=snappyhexmesh.case,
    recipe=steadyincomp.recipe,
    solution_par=solutionparams,
    interval=2,
    write=Toggle(False),
    run=Toggle(False))  # -> report, solution, is_running, timestep, residual_fields, residual_values, log_files; plug-in component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
# VISUALIZE MESH
panel_32 = Panel(solution.report)
panel_33 = Panel(solution.residual_fields)
loadprobesvalue = Butterfly_LoadProbesValue(solution=solution.solution, field="p")  # -> values; plug-in component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
loadprobesvalue_2 = Butterfly_LoadProbesValue(solution=solution.solution, field="U")  # -> values; plug-in component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
panel_34 = Panel(solution.residual_values)

rec = Rectangle({Plane=PlaneXY(1, -6, 0), Size=Domain2(u=0..15, v=0..5)})
# PLOT RESIDUALS
plotresiduals = Butterfly_PlotResiduals(solution=solution.solution, rect=rec, target_res=0.0001, port=0.1, method=0, load=Toggle(True))  # -> report, time_range, curves, port, residual_line, colors; plug-in component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
preview_3 = CustomPreview(
    Geometry=plotresiduals.residual_line,
    Shader={diffuse=RGB(255, 105, 180), emission=RGB(76, 32, 54), shine=0.5, specular=RGB(255, 255, 255), transparency=0})
preview_4 = CustomPreview(Geometry=plotresiduals.curves, Shader=plotresiduals.colors)

# ---- group: points
pt = Point(flatten_2)

# ---- group: vectors
vec_4 = Vector(loadprobesvalue_2)

# ----
vlen = VectorLength(Vector=vec_4)
bnd = Bounds(Numbers=vlen)
dedomain = DeconstructDomain(Domain=bnd)  # -> Start, End
gradient = Gradient(
    LowerLimit=dedomain.End,
    UpperLimit=dedomain.Start,
    Parameter=vlen,
    stops=[0: RGB(234, 38, 0), 0.25: RGB(234, 126, 0), 0.5: RGB(254, 244, 84), 0.75: RGB(173, 203, 249), 1: RGB(75, 107, 169)])
scale = Slider(0.7, range=0..1)
multiplication = Multiplication(A=vec_4, B=scale)
vdisex_3 = VectorDisplayEx(Point=pt, Vector=multiplication, Colour=gradient, Width=Slider(1, range=0..5))

gradientlibrary = Ladybug_GradientLibrary(gradIndex="7")  # -> customColors; plug-in component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
# 4. RESULT VISUALIZATION
mjoin = MeshJoin(Meshes=flatten)
legendpar = Ladybug_LegendParameters(customColors=flatten(gradientlibrary))  # -> legendPar; plug-in component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
recolormesh = Ladybug_RecolorMesh(analysisResult=loadprobesvalue, inputMesh=mjoin, legendPar=legendpar, analysisTitle="Pressure.", legendTitle="Pa.")  # -> readMe, newMesh, newLegend, legendBasePt, meshColors, legendColors; plug-in component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
ladybug = Ladybug_Ladybug()  # -> Vviiiiiiiiiizzz; plug-in component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
faceb = FaceBoundaries(Mesh=recolormesh.newMesh)

gradientlibrary_2 = Ladybug_GradientLibrary(gradIndex="1")  # -> customColors; plug-in component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
legendpar_2 = Ladybug_LegendParameters(customColors=flatten(gradientlibrary_2))  # -> legendPar; plug-in component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
recolormesh_2 = Ladybug_RecolorMesh(analysisResult=vlen, inputMesh=mjoin, legendPar=legendpar_2, analysisTitle="Velocity.", legendTitle="m/s")  # -> readMe, newMesh, newLegend, legendBasePt, meshColors, legendColors; plug-in component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

# ----
# F00_V
mesh = Mesh([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])
# South Wind_V
mesh_2 = Mesh(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)

# ----
# F01_V
mesh_3 = Mesh([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])
mesh_4 = Mesh(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)

# ----
# F00_P
mesh_5 = Mesh([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])
# South Wind_P
mesh_6 = Mesh(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)

# ----
# F01_P
mesh_7 = Mesh(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)
mesh_8 = Mesh([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])

panel_35 = Panel("Section 02_Pressure")
toggle_3 = BooleanToggle(False)
panel_36 = Panel("F01_Pressure")
panel_37 = Panel("F01_Velocity")
panel_38 = Panel("Section 01_Pressure")
panel_39 = Panel("Section 01_Velocity")
panel_40 = Panel("F00_Velocity")
panel_41 = Panel("F00_Pressure")

# ----
# Section 01_P
mesh_9 = Mesh(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)
mesh_10 = Mesh([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])

# ----
# Section 02_P
mesh_11 = Mesh([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])
mesh_12 = Mesh(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)

# ----
# Section 01_V
mesh_13 = Mesh(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)
mesh_14 = Mesh([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])

# ----
# Section 02_V
mesh_15 = Mesh(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)
mesh_16 = Mesh([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])

captureview = Ladybug_CaptureView(
    fileName="Section 02_Velocity",
    folder="C:\Users\Bijit\Desktop\butterfly0005 (1)\IAF",
    viewNames="01",
    imageHeight="1080",
    keepAspectR=toggle_3,
    capture=toggle_3)  # -> Output; plug-in component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
