# Grasshopper definition Shadow study.gh (Grasshopper 0.9.76)
# plug-ins: Python Interpreter

ladybug = Ladybug_Ladybug()  # -> Vviiiiiiiiiizzz; plug-in component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
analysisperiod = Ladybug_AnalysisPeriod(
    fromMonth=Slider(12, range=1..12),
    fromDay=Slider(21, range=1..31),
    toMonth=Slider(12, range=1..12),
    toDay=Slider(21, range=1..31))  # -> readMe, analysisPeriod; plug-in component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
constructlocation = Ladybug_ConstructLocation(locationName="Shahibaug", latitude="23.058682", longitude="72.590588", timeZone="+05.30", elevation="64")  # -> location; plug-in component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
ground = Geometry(<brep referenced from the Rhino model>)
area = Area(Geometry=ground)  # -> Area, Centroid
panel = Panel(analysisperiod.analysisPeriod)
sunpath = Ladybug_SunPath(
    location=constructlocation,
    hour=12,
    day=21,
    month=12,
    timeStep=1,
    analysisPeriod=analysisperiod.analysisPeriod,
    centerPt=area.Centroid,
    sunPathScale=".9",
    sunScale="1.5",
    dailyOrAnnualSunPath=True)  # -> readMe, sunVectors, sunAltitudes, sunAzimuths, port, sunSpheresMesh, sunPathCrvs, compassCrvs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; plug-in component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
item = ListItem(List=panel, Index="0", Wrap=True)
item_2 = ListItem(List=panel, Index="1", Wrap=True)
panel_2 = Panel(item)
panel_3 = Panel(item_2)
toggle = BooleanToggle(True)
brep = Brep([<brep referenced from the Rhino model> x4])
geo = Geometry([sunpath.compassCrvs, sunpath.sunPathCrvs])
split = TextSplit(Text=panel_2, Separators="(,) ")
mcol = MeshColours(Colours=ColourSwatch(SwatchColor=RGB(255, 136, 0)))
preview = CustomPreview(Geometry=geo, Shader=ColourSwatch(SwatchColor=RGB(105, 105, 105)))
panel_4 = Panel(split)
item_3 = ListItem(List=panel_4, Index="3", Wrap=True)
item_4 = ListItem(List=panel_4, Index="1", Wrap=True)
item_5 = ListItem(List=panel_4, Index="5", Wrap=True)
legendpar = Ladybug_LegendParameters(legendScale=".9")  # -> legendPar; plug-in component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
sunlighthoursanalysis = Ladybug_SunlightHoursAnalysis(
    geometry=flatten(brep),
    gridSize="1",
    disFromBase="0.5",
    sunVectors=flatten(sunpath.sunVectors),
    timeStep=1,
    legendPar=flatten(legendpar),
    parallel=toggle,
    runIt=toggle)  # -> readMe, contextMesh, analysisMesh, testPts, testVec, port, sunlightHoursResult, sunlightHoursMesh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; plug-in component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
mesh = Mesh(sunlighthoursanalysis.sunlightHoursMesh)
geo_2 = Geometry(sunlighthoursanalysis.sunlightHoursLegend)
data = Data(sunlighthoursanalysis.sunlightHoursResult)
date = ConstructDate(Year="2018", Month=item_4, Day=item_3, Hour=item_5, Minute=0, Second=0)
panel_5 = Panel(date)
tag = TextTag(Location="-100,-115,0", Text=panel_5)
tag_2 = TextTag3D(Location="-100,-115,0", Text=panel_5, Size="10", Colour=ColourSwatch(SwatchColor=RGB(0, 0, 0)), Justification=7)
