# Grasshopper definition Shadow study.gh (Grasshopper 0.9.76)
# plug-ins: Python Interpreter

honeybee = Honeybee_Honeybee()  # -> Vviiiiiiiiiizzz; plug-in component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
ladybug = Ladybug_Ladybug()  # -> Vviiiiiiiiiizzz; plug-in component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
analysisperiod = Ladybug_AnalysisPeriod(
    fromMonth=Slider(12, range=1..12),
    fromDay=Slider(21, range=1..31),
    toMonth=Slider(12, range=1..12),
    toDay=Slider(21, range=1..31))  # -> readMe, analysisPeriod; plug-in component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
constructlocation = Ladybug_ConstructLocation(locationName="Godhra", latitude="22.809693", longitude="73.508246", timeZone="+05.30", elevation="87")  # -> location; plug-in component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
ground = Geometry([<brep referenced from the Rhino model> x2])
area = Area(Geometry=ground)  # -> Area, Centroid
panel = Panel(analysisperiod.analysisPeriod)
sunpath = Ladybug_SunPath(
    location=constructlocation,
    hour=12,
    day=21,
    month=12,
    timeStep=1,
    analysisPeriod=analysisperiod.analysisPeriod,
    sunPathScale="2",
    sunScale="2",
    dailyOrAnnualSunPath=True)  # -> readMe, sunVectors, sunAltitudes, sunAzimuths, port, sunSpheresMesh, sunPathCrvs, compassCrvs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; plug-in component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
legendpar = Ladybug_LegendParameters(legendLocation="450,-550,0", legendScale=".85")  # -> legendPar; plug-in component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
item = ListItem(List=panel, Index="0", Wrap=True)
item_2 = ListItem(List=panel, Index="1", Wrap=True)
panel_2 = Panel(item)
panel_3 = Panel(item_2)
toggle = BooleanToggle(True)
brep = Brep([<brep referenced from the Rhino model> x29])
geo = Geometry([sunpath.compassCrvs, sunpath.sunPathCrvs])
split = TextSplit(Text=panel_2, Separators="(,) ")
sunlighthoursanalysis = Ladybug_SunlightHoursAnalysis(
    geometry=flatten(brep),
    gridSize="5",
    disFromBase="0.5",
    sunVectors=flatten(sunpath.sunVectors),
    timeStep=1,
    legendPar=flatten(legendpar),
    parallel=toggle,
    runIt=toggle)  # -> contextMesh, analysisMesh, testPts, testVec, port, sunlightHoursResult, sunlightHoursMesh, sunlightHoursLegend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; plug-in component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
mcol = MeshColours(Mesh=sunpath.sunSpheresMesh, Colours=ColourSwatch(SwatchColor=RGB(255, 98, 36)))
preview = CustomPreview(Geometry=geo, Shader=ColourSwatch(SwatchColor=RGB(105, 105, 105)))
northarrow = Ladybug_North(north=Slider(0, range=0..360), centerPt="850,-500,0", scale=Slider(5, range=0..100))  # -> northSign; plug-in component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
panel_4 = Panel(split)
item_3 = ListItem(List=panel_4, Index="3", Wrap=True)
item_4 = ListItem(List=panel_4, Index="1", Wrap=True)
item_5 = ListItem(List=panel_4, Index="5", Wrap=True)
mesh = Mesh(sunlighthoursanalysis.sunlightHoursMesh)
geo_2 = Geometry(sunlighthoursanalysis.sunlightHoursLegend)
date = ConstructDate(Year="2018", Month=item_4, Day=item_3, Hour=item_5, Minute=0, Second=0)
mcol_2 = MeshColours(Mesh=northarrow, Colours=ColourSwatch(SwatchColor=RGB(0, 0, 0)))
panel_5 = Panel(date)
tag = TextTag(Location="-350,-550,0", Text=panel_5)
tag_2 = TextTag3D(Location="-350,-550,0", Text=panel_5, Size="30", Colour=ColourSwatch(SwatchColor=RGB(0, 0, 0)), Justification=7)
