# Grasshopper definition windrose_R0.gh (Grasshopper 0.9.76)
# plug-ins: Python Interpreter

ladybug = Ladybug_Ladybug()  # -> Vviiiiiiiiiizzz; plug-in component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
panel = Panel("C:\Users\Bijit\Dropbox\Github\Building-Science\EPW\IND_Ahmedabad.426470_IWEC.epw")
importepw = Ladybug_ImportEpw(epwFile=panel)  # -> readMe, latitude, location, dryBulbTemperature, dewPointTemperature, relativeHumidity, windSpeed, windDirection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; plug-in component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
brep = Brep([<brep referenced from the Rhino model> x2])
brep_2 = Brep([<brep referenced from the Rhino model> x27])
windrose = Ladybug_WindRose(north=0, hourlyWindDirection=importepw.windDirection, hourlyWindSpeed=importepw.windSpeed, scale="5", runIt=Toggle(True))  # -> readMe, calmRoseMesh, windRoseMesh, windRoseCrvs, windRoseCenPts, legend, legendBasePts, title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; plug-in component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
mcol = MeshColours(Mesh=brep, Colours=ColourSwatch(SwatchColor=RGBA(255, 255, 255, 30)))
mcol_2 = MeshColours(Mesh=brep_2, Colours=ColourSwatch(SwatchColor=RGB(247, 255, 0)))
mesh = Mesh(windrose.windRoseMesh)
