# Grasshopper definition Wind Direction.gh (Grasshopper 0.9.76)
# plug-ins: Python Interpreter

ladybug = Ladybug_Ladybug()  # -> Vviiiiiiiiiizzz; plug-in component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
honeybee = Honeybee_Honeybee()  # -> Vviiiiiiiiiizzz; plug-in component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
fly = Ladybug_fly(fly=Toggle(False))  # -> Vviiiiiiiiiizzz; plug-in component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
panel = Panel("C:\Users\Bijit\Dropbox\Github\Building-Science\EPW\IND_Ahmedabad.426470_IWEC.epw")
captureview = Ladybug_CaptureView(
    folder="C:\Users\Bijit\Desktop\Export",
    viewNames="01",
    imageWidth="1920",
    imageHeight="1080",
    transparBack=Toggle(False),
    capture=Toggle(True))  # -> imagePath; plug-in component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
brep = Brep(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)
importepw = Ladybug_ImportEpw(epwFile=panel)  # -> readMe, latitude, location, dryBulbTemperature, dewPointTemperature, relativeHumidity, windSpeed, windDirection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; plug-in component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
analysisperiod = Ladybug_AnalysisPeriod(fromMonth=Slider(1, range=1..12), toMonth=Slider(12, range=1..12))  # -> readMe, analysisPeriod; plug-in component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
mcol = MeshColours(Mesh=brep, Colours=ColourSwatch(SwatchColor=RGB(255, 0, 0)))
northarrow = Ladybug_North(centerPt="1500,350,0", scale="10")  # -> northSign; plug-in component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
windboundaryprofile = Ladybug_WindBoundaryProfile(
    windSpeed_tenMeters=importepw.windSpeed,
    windDirection=importepw.windDirection,
    analysisPeriod=analysisperiod.analysisPeriod,
    annualHourlyData=flatten(importepw.directNormalRadiation),
    conditionalStatement="a>2",
    windVectorScale="5",
    windProfileHeight=Slider(70, range=0..100))  # -> readMe, port, windSpeeds, windVectors, vectorAnchorPts, port_2, windVectorMesh, windProfileCurve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; plug-in component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
windrose = Ladybug_WindRose(
    north=0,
    hourlyWindDirection=importepw.windDirection,
    hourlyWindSpeed=importepw.windSpeed,
    analysisPeriod=analysisperiod.analysisPeriod,
    maxFrequency="15",
    scale="5",
    runIt=Toggle(True))  # -> readMe, calmRoseMesh, windRoseMesh, windRoseCrvs, windRoseCenPts, legend, legendBasePts, title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; plug-in component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
num = Number(windboundaryprofile.windSpeeds)
geo = Geometry(windboundaryprofile.axesText)
mesh = Mesh(windboundaryprofile.legend)
mesh_2 = Mesh([windrose.calmRoseMesh, windrose.windRoseMesh])
mesh_3 = Mesh(windrose.title)
mesh_4 = Mesh(windrose.legend)  # disabled
geo_2 = Geometry(windrose.windRoseCrvs)
pt = Point(windrose.windRoseCenPts)
vdis = VectorDisplay(Anchor=windboundaryprofile.vectorAnchorPts)
scale = Scale(
    Geometry=[windboundaryprofile.windVectorMesh, windboundaryprofile.windProfileCurve, geo, mesh],
    Center=Point(0, 0, 0),
    Factor=Slider(5, range=0..20))  # -> Geometry, Transform
