# Grasshopper definition windrose_R0.gh (Grasshopper 0.9.76)
# plug-ins: Python Interpreter

ladybug = Ladybug_Ladybug()  # -> Vviiiiiiiiiizzz; plug-in component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
panel = Panel("C:\Users\Bijit\Dropbox\Github\Building-Science\EPW\IND_Ahmedabad.426470_IWEC.epw")
importepw = Ladybug_ImportEpw(epwFile=panel)  # -> readMe, latitude, location, dryBulbTemperature, dewPointTemperature, relativeHumidity, windSpeed, windDirection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; plug-in component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
month = Slider(12, range=0..12)
month_2 = Slider(9, range=0..12)
month_3 = Slider(2, range=0..12)
month_4 = Slider(3, range=0..12)
month_5 = Slider(11, range=0..12)
month_6 = Slider(5, range=0..12)
month_7 = Slider(6, range=0..12)
month_8 = Slider(8, range=0..12)
analysisperiod = Ladybug_AnalysisPeriod(fromMonth=month, toMonth=month_3)  # -> readMe, analysisPeriod; plug-in component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
analysisperiod_2 = Ladybug_AnalysisPeriod(fromMonth=month_2, toMonth=month_5)  # -> readMe, analysisPeriod; plug-in component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
analysisperiod_3 = Ladybug_AnalysisPeriod(fromMonth=month_4, toMonth=month_6)  # -> readMe, analysisPeriod; plug-in component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
analysisperiod_4 = Ladybug_AnalysisPeriod(fromMonth=month_7, toMonth=month_8)  # -> readMe, analysisPeriod; plug-in component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
toggle = BooleanToggle(False)
toggle_2 = BooleanToggle(False)
windrose = Ladybug_WindRose(
    north=0,
    hourlyWindDirection=importepw.windDirection,
    hourlyWindSpeed=importepw.windSpeed,
    scale="1.5",
    runIt=Toggle(True))  # -> readMe, calmRoseMesh, windRoseMesh, windRoseCrvs, windRoseCenPts, legend, legendBasePts, title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; plug-in component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
windrose_2 = Ladybug_WindRose(
    north=0,
    hourlyWindDirection=importepw.windDirection,
    hourlyWindSpeed=importepw.windSpeed,
    analysisPeriod=analysisperiod_4.analysisPeriod,
    centerPoint="1500,0,0",
    scale="1",
    runIt=Toggle(True))  # -> readMe, calmRoseMesh, windRoseMesh, windRoseCrvs, windRoseCenPts, legend, legendBasePts, title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; plug-in component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
windrose_3 = Ladybug_WindRose(
    north=0,
    hourlyWindDirection=importepw.windDirection,
    hourlyWindSpeed=importepw.windSpeed,
    analysisPeriod=analysisperiod_2.analysisPeriod,
    centerPoint="3000,0,0",
    scale="1.3",
    runIt=Toggle(True))  # -> readMe, calmRoseMesh, windRoseMesh, windRoseCrvs, windRoseCenPts, legend, legendBasePts, title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; plug-in component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
windrose_4 = Ladybug_WindRose(
    north=0,
    hourlyWindDirection=importepw.windDirection,
    hourlyWindSpeed=importepw.windSpeed,
    analysisPeriod=analysisperiod.analysisPeriod,
    centerPoint="4500,0,0",
    showFrequency=toggle,
    showAverageVelocity=toggle,
    scale=".9",
    runIt=Toggle(True))  # -> readMe, calmRoseMesh, windRoseMesh, windRoseCrvs, windRoseCenPts, legend, legendBasePts, title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; plug-in component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
windrose_5 = Ladybug_WindRose(
    north=0,
    hourlyWindDirection=importepw.windDirection,
    hourlyWindSpeed=importepw.windSpeed,
    analysisPeriod=analysisperiod_3.analysisPeriod,
    centerPoint="6000,0,0",
    showFrequency=toggle_2,
    showAverageVelocity=toggle_2,
    scale="1.2",
    runIt=Toggle(True))  # -> readMe, calmRoseMesh, windRoseMesh, windRoseCrvs, windRoseCenPts, legend, legendBasePts, title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; plug-in component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
mcol = MeshColours(Colours=ColourSwatch(SwatchColor=RGB(255, 0, 0)))
mcol_2 = MeshColours(Colours=ColourSwatch(SwatchColor=RGB(0, 168, 34)))
