# Grasshopper definition Wind Direction.gh (Grasshopper 0.9.76)
# plug-ins: Python Interpreter

ladybug = Ladybug_Ladybug()  # -> Vviiiiiiiiiizzz; plug-in component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
honeybee = Honeybee_Honeybee()  # -> Vviiiiiiiiiizzz; plug-in component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
number_slider = Slider(12, range=1..12)
fly = Ladybug_fly(fly=Toggle(False))  # -> Vviiiiiiiiiizzz; plug-in component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
fly_2 = Ladybug_fly(inputSliders=Slider(0, range=0..2), fly=Toggle(False))  # -> Vviiiiiiiiiizzz; plug-in component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
panel = Panel("C:\Users\Bijit\Dropbox\Github\Building-Science\EPW\IND_Ahmedabad.426470_IWEC.epw")
captureview = Ladybug_CaptureView(
    folder="C:\Users\Bijit\Desktop\Export",
    viewNames="01",
    imageWidth="1920",
    imageHeight="1080",
    transparBack=Toggle(False),
    capture=Toggle(True))  # -> imagePath; plug-in component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
analysisperiod = Ladybug_AnalysisPeriod(fromMonth=fly_2, toMonth=fly_2)  # -> readMe, analysisPeriod; plug-in component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
importepw = Ladybug_ImportEpw(epwFile=panel)  # -> readMe, latitude, location, dryBulbTemperature, dewPointTemperature, relativeHumidity, windSpeed, windDirection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; plug-in component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
analysisperiod_2 = Ladybug_AnalysisPeriod(fromMonth=number_slider, toMonth=number_slider)  # -> readMe, analysisPeriod; plug-in component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
panel_2 = Panel(analysisperiod.analysisPeriod)
windboundaryprofile = Ladybug_WindBoundaryProfile(
    windSpeed_tenMeters=importepw.windSpeed,
    windDirection=importepw.windDirection,
    analysisPeriod=analysisperiod_2.analysisPeriod,
    annualHourlyData=flatten(importepw.directNormalRadiation),
    windVectorScale="5")  # -> readMe, port, windSpeeds, windVectors, vectorAnchorPts, port_2, windVectorMesh, windProfileCurve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; plug-in component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
windrose = Ladybug_WindRose(
    north=0,
    hourlyWindDirection=importepw.windDirection,
    hourlyWindSpeed=importepw.windSpeed,
    analysisPeriod=analysisperiod_2.analysisPeriod,
    maxFrequency="35",
    runIt=Toggle(True))  # -> readMe, calmRoseMesh, windRoseMesh, windRoseCrvs, windRoseCenPts, legend, legendBasePts, title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; plug-in component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
analysisperiod_3 = Ladybug_AnalysisPeriod(fromMonth="10", toMonth="10")  # -> readMe, analysisPeriod; plug-in component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
analysisperiod_4 = Ladybug_AnalysisPeriod(fromMonth="11", toMonth="11")  # -> readMe, analysisPeriod; plug-in component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
analysisperiod_5 = Ladybug_AnalysisPeriod(fromMonth="4", toMonth="4")  # -> readMe, analysisPeriod; plug-in component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
analysisperiod_6 = Ladybug_AnalysisPeriod(fromMonth="5", toMonth="5")  # -> readMe, analysisPeriod; plug-in component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
analysisperiod_7 = Ladybug_AnalysisPeriod(fromMonth="12", toMonth="12")  # -> readMe, analysisPeriod; plug-in component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
analysisperiod_8 = Ladybug_AnalysisPeriod(fromMonth="6", toMonth="6")  # -> readMe, analysisPeriod; plug-in component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
analysisperiod_9 = Ladybug_AnalysisPeriod(fromMonth="9", toMonth="9")  # -> readMe, analysisPeriod; plug-in component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
analysisperiod_10 = Ladybug_AnalysisPeriod(fromMonth="7", toMonth="7")  # -> readMe, analysisPeriod; plug-in component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
analysisperiod_11 = Ladybug_AnalysisPeriod(fromMonth="8", toMonth="8")  # -> readMe, analysisPeriod; plug-in component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
analysisperiod_12 = Ladybug_AnalysisPeriod(fromMonth="3", toMonth="3")  # -> readMe, analysisPeriod; plug-in component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
analysisperiod_13 = Ladybug_AnalysisPeriod(fromMonth="1", toMonth="1")  # -> readMe, analysisPeriod; plug-in component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
analysisperiod_14 = Ladybug_AnalysisPeriod(fromMonth="2", toMonth="2")  # -> readMe, analysisPeriod; plug-in component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
northarrow = Ladybug_North(centerPt="50,-50,0", scale=".5")  # -> northSign; disabled; plug-in component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
mesh = Mesh(windboundaryprofile.axesText)
num = Number(windboundaryprofile.windSpeeds)
mesh_2 = Mesh(windboundaryprofile.legend)  # disabled
mesh_3 = Mesh([windrose.calmRoseMesh, windrose.windRoseMesh])
mesh_4 = Mesh(windrose.title)
geo = Geometry(windrose.windRoseCrvs)
mesh_5 = Mesh(windrose.legend)
pt = Point(windrose.windRoseCenPts)
vdis = VectorDisplay(Anchor=windboundaryprofile.vectorAnchorPts)
scale = Scale(
    Geometry=[windboundaryprofile.windVectorMesh, windboundaryprofile.windProfileCurve, mesh],
    Center=Point(0, 0, 0),
    Factor=Slider(15, range=0..20))  # -> Geometry, Transform
panel_3 = Panel()
item = ListItem(List=panel_3, Index="0", Wrap=True)
item_2 = ListItem(List=panel_3, Index="1", Wrap=True)
panel_4 = Panel(item)
panel_5 = Panel(item_2)
split = TextSplit(Text=panel_4, Separators="(,) ")
panel_6 = Panel(split)
item_3 = ListItem(List=panel_6, Index="3", Wrap=True)
item_4 = ListItem(List=panel_6, Index="1", Wrap=True)
item_5 = ListItem(List=panel_6, Index="5", Wrap=True)
date = ConstructDate(Year="2018", Month=item_4, Day=item_3, Hour=item_5, Minute=0, Second=0)
panel_7 = Panel(date)
tag = TextTag(Location="-115,-150,0", Text=panel_7)
tag_2 = TextTag3D(Location="-115,-150,0", Text=panel_7, Size="10", Colour=ColourSwatch(SwatchColor=RGB(0, 0, 0)), Justification=7)
