# Grasshopper definition windrose.gh (Grasshopper 0.9.76)
# plug-ins: Python Interpreter

ladybug = Ladybug_Ladybug()  # -> Vviiiiiiiiiizzz; plug-in component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
panel = Panel("C:\Users\Bijit\Dropbox\Work\Simulation\IND_Ahmedabad.426470_IWEC\IND_Ahmedabad.426470_IWEC.epw")
importepw = Ladybug_ImportEpw(epwFile=panel)  # -> readMe, latitude, location, dryBulbTemperature, dewPointTemperature, relativeHumidity, windSpeed, windDirection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; plug-in component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
month = Slider(7, range=0..12)
month_2 = Slider(3, range=0..12)
month_3 = Slider(10, range=0..12)
month_4 = Slider(6, range=0..12)
month_5 = Slider(11, range=0..12)
month_6 = Slider(2, range=0..12)
analysisperiod = Ladybug_AnalysisPeriod(fromMonth=month, toMonth=month_3)  # -> readMe, analysisPeriod; plug-in component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
analysisperiod_2 = Ladybug_AnalysisPeriod(fromMonth=month_2, toMonth=month_4)  # -> readMe, analysisPeriod; plug-in component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
analysisperiod_3 = Ladybug_AnalysisPeriod(fromMonth=month_5, toMonth=month_6)  # -> readMe, analysisPeriod; plug-in component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
toggle = BooleanToggle(True)
windrose = Ladybug_WindRose(
    north=0,
    hourlyWindDirection=importepw.windDirection,
    hourlyWindSpeed=importepw.windSpeed,
    scale=".1",
    runIt=Toggle(True))  # -> readMe, calmRoseMesh, windRoseMesh, windRoseCrvs, windRoseCenPts, legend, legendBasePts, title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; plug-in component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
windrose_2 = Ladybug_WindRose(
    north=0,
    hourlyWindDirection=importepw.windDirection,
    hourlyWindSpeed=importepw.windSpeed,
    analysisPeriod=analysisperiod_3.analysisPeriod,
    centerPoint="100,0,0",
    scale=".065",
    runIt=Toggle(True))  # -> readMe, calmRoseMesh, windRoseMesh, windRoseCrvs, windRoseCenPts, legend, legendBasePts, title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; plug-in component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
windrose_3 = Ladybug_WindRose(
    north=0,
    hourlyWindDirection=importepw.windDirection,
    hourlyWindSpeed=importepw.windSpeed,
    analysisPeriod=analysisperiod_2.analysisPeriod,
    centerPoint="200,0,0",
    scale=".11",
    runIt=Toggle(True))  # -> readMe, calmRoseMesh, windRoseMesh, windRoseCrvs, windRoseCenPts, legend, legendBasePts, title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; plug-in component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
windrose_4 = Ladybug_WindRose(
    north=0,
    hourlyWindDirection=importepw.windDirection,
    hourlyWindSpeed=importepw.windSpeed,
    analysisPeriod=analysisperiod.analysisPeriod,
    centerPoint="300,0,0",
    showFrequency=toggle,
    showAverageVelocity=toggle,
    scale=".07",
    runIt=Toggle(True))  # -> readMe, calmRoseMesh, windRoseMesh, windRoseCrvs, windRoseCenPts, legend, legendBasePts, title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; plug-in component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
mcol = MeshColours(Mesh=windrose_4.averageVelocityMesh, Colours=ColourSwatch(SwatchColor=RGB(255, 0, 0)))
mcol_2 = MeshColours(Mesh=windrose_4.frequencyMesh, Colours=ColourSwatch(SwatchColor=RGB(0, 168, 34)))
